# Grasshopper definition rectangle.gh (Grasshopper 1.0.7)

# ---- group: RH_IN:side2
number_slider = Slider(9, range=0..100)

# ---- group: RH_IN:side1
number_slider_2 = Slider(11, range=0..100)

# ----
rectangle = Rectangle(Plane=PlaneXY(0, 0, 0), XSize=number_slider_2, YSize=number_slider, Radius=0)  # -> Rectangle, Length
surface = Surface(rectangle.Rectangle)
unit_z = UnitZ(Factor=rectangle.Length)
extrude = Extrude(Base=surface, Direction=unit_z)
deconstruct_brep = DeconstructBrep(Brep=extrude)  # -> Faces, Edges, Vertices

# ---- group: RH_OUT:box
mesh = Mesh(deconstruct_brep.Faces)

# ---- group: RH_OUT:curve
curve = Curve(deconstruct_brep.Edges)
